# Grasshopper definition Server.gh (Grasshopper 1.0.7)
# plug-ins: RabbitMQ.GH

# ----
# Server setup
host_name = Panel("localhost")
queue_name = Panel("request-queue")
server = Server(Run=Toggle(False), Host=host_name, Queue=queue_name)
panel = Panel(server)
